# Grasshopper definition RL_Voxel_V1.gh (Grasshopper 1.0.8)
# plug-ins: MeshEdit Components, MetaHopper, Cyclops

# ----
# output_steps folder path
panel = Panel("output_steps_vec")
relpath = RelativePath(Path=panel)
panel_2 = Panel(relpath)

number_slider = Slider(72, range=0..72)
path = FilePath(panel_2)
py3 = Python3Script(path=path, frame=Slider(100, range=0..100))  # -> out, a
# ---------- py3: Python ----------
import Rhino.Geometry as rg
import json
import os

json_file = os.path.join(path, f"step_{int(frame):03}.json")

with open(json_file, 'r') as f:
    data = json.load(f)

voxels = data["voxels"]

boxes = []

grid_size = len(voxels)

for x in range(grid_size):
    for y in range(grid_size):
        for z in range(grid_size):
            if voxels[x][y][z] == 1:
                corner1 = rg.Point3d(x, y, z)
                corner2 = rg.Point3d(x + 1, y + 1, z + 1)
                bbox = rg.BoundingBox(corner1, corner2)
                box = rg.Box(bbox)
                boxes.append(box)

a = boxes
# ---------- end py3 ----------

# ----
# epw
panel_3 = Panel("https://energyplus-weather.s3.amazonaws.com/europe_wmo_region_6/ESP/ESP_Madrid.082210_IWEC/ESP_Madrid.082210_IWEC.zip")
downloadepw = LBDownloadWeather(weather_URL=panel_3)  # -> epw_file, stat_file, ddy_file; plug-in component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

# ---- group: Specify hemisphere subdivision
subdivision = Subdivision(CyclopsValueList="EqualAreaAspectSubdivision", version="1.0.0.0")
cell_count = Slider(512, range=0..1000)
hemisphere = Hemisphere(CellCount=cell_count, Subdivision=subdivision, method="Hemisphere", version="0.0.0.DevBuild")

# ----
# reward weights
avergae_rad_per_voxel_weight = Slider(0.9, range=0.1..1)
radiation_per_voxel_weight = Slider(0.5, range=0.1..1)
sunhours_weight = Slider(0.8, range=0.1..1)
symmetry_weight = Slider(0.4, range=0.1..1)

relpath_2 = RelativePath(Path="temp_reward.json")
panel_4 = Panel(relpath_2)

# ----
# reads voxels, makes boxes and check symmetry
panel_5 = Panel("temp_voxel_input.json")
trigger = Trigger(Interval=100, TimerInterval=100, Target=py3_2)

relpath_3 = RelativePath(Path=panel_5)

py3_2 = Python3Script(path=relpath_3)  # -> out, a, sym; inputs path: String
# ---------- py3_2: Python ----------
import json
import os
import Rhino.Geometry as rg

# Inputs: path (string)
# Output: boxes (list of Box), best_symmetry (float)

boxes = []

if os.path.exists(path):
    with open(path, 'r') as f:
        voxels = json.load(f)["voxels"]

    size = len(voxels)
    for x in range(size):
        for y in range(size):
            for z in range(size):
                if voxels[x][y][z] == 1:
                    pt1 = rg.Point3d(x, y, z)
                    pt2 = rg.Point3d(x + 1, y + 1, z + 1)
                    bbox = rg.BoundingBox(pt1, pt2)
                    boxes.append(rg.Box(bbox))

# --- Symmetry Calculation ---
def symmetry_score(boxes):
    if not boxes:
        return 0.0

    # Get all box centers
    centers = [b.Center for b in boxes]

    # Get bounding box for the entire shape
    bbox = rg.BoundingBox(centers)

    # Midpoints for mirroring
    mid_x = (bbox.Min.X + bbox.Max.X) / 2.0
    mid_y = (bbox.Min.Y + bbox.Max.Y) / 2.0
    mid_z = (bbox.Min.Z + bbox.Max.Z) / 2.0

    # Store centers in a hash set for fast lookup
    center_set = {(round(pt.X, 3), round(pt.Y, 3), round(pt.Z, 3)) for pt in centers}

    def check_axis(axis):
        matches = 0
        for pt in centers:
            if axis == "x":
                mirror_pt = (2*mid_x - pt.X, pt.Y, pt.Z)
            elif axis == "y":
                mirror_pt = (pt.X, 2*mid_y - pt.Y, pt.Z)
            else:  # "z"
                mirror_pt = (pt.X, pt.Y, 2*mid_z - pt.Z)
            if (round(mirror_pt[0], 3), round(mirror_pt[1], 3), round(mirror_pt[2], 3)) in center_set:
                matches += 1
        return matches / len(centers)

    x_score = check_axis("x")
    y_score = check_axis("y")
    z_score = check_axis("z")

    return max(x_score, y_score, z_score)

best_symmetry = symmetry_score(boxes)

# Outputs
a = boxes
sym = best_symmetry
# ---------- end py3_2 ----------
geo = Geometry(graft(py3_2.a))
debrep = DeconstructBrep(Brep=geo)  # -> simplify(Faces), Edges, Vertices
mesh_uv = MeshSurface(Surface=debrep.Faces, UCount="3", VCount="3", Overhang=True, Equalize=False)

mesh = Mesh(mesh_uv)

# ---- group: Create panels
facade_panels = Mesh(mesh)

# ----
# symmetry score
data = Data(py3_2.sym)
panel_6 = Panel(data)

# ----
# CUMULATIVE RADIATION
explode = MeshExplode(Mesh=mesh, Interpolate=False)
G = Geometry(Mesh=flatten(mesh), MaterialName="Default Material", Parameter=0, method="Geometry", version="1.0.0.0")
face_normals = FaceNormals(Mesh=facade_panels)  # -> Centers, Normals
trim = TrimTree(Tree=explode, Depth=1)
A = AnalysisPoint(Position=face_normals.Centers, Direction=face_normals.Normals, method="Analysis Point", version="1.0.0.0")
analysis_points = CyclopsObject(A, version="0.0.0.DevBuild")
trim_2 = TrimTree(Tree=analysis_points, Depth=1)
hemisphere_2 = Data(hemisphere)

# ---- group: Cyclops geometry
G_2 = GeometryGroup(
    Name="Default Geometry Group",
    Geometry=G,
    VisibilityMask="""{
  "Mask1": true,
  "Mask2": true,
  "Mask3": true,
  "Mask4": true,
  "Mask5": true,
  "Mask6": true,
  "Mask7": true,
  "Mask8": true,
  "BitMap": [
    true,
    true,
    true,
    true,
    true,
    true,
    true,
    true
  ]
}""",
    Transforms={TransformCount=1, Name="Generic", m00=1, m01=0, m02=0, m03=0, m10=0, m11=1, m12=0, m13=0, m20=0, m21=0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},
    IntersectionType="Target",
    method="Geometry Group",
    version="1.0.0.0")

# ---- group: Create sky instance from EPW file
W = Weather(Path=downloadepw.epw_file, NorthVector=Vector(0, 1, 0), LuminousEfficacyModel="MeasuredIlluminance", version="1.0.0.0")
fytp = FullYear(TimeStep=1, version="1.0.0.0")
ss = SkySeries(
    Weather=W,
    Hemisphere=hemisphere_2,
    TimePattern=fytp,
    LuminanceDistributionModel="CIEStandardSkyModel",
    version="1.0.0.0")

# ---- group: Create shading masks for each analysis point
scene_objects = CyclopsObject(G_2, version="0.0.0.DevBuild")
hemisphere_3 = Data(hemisphere)
analysis_points_2 = CyclopsObject(trim_2, version="0.0.0.DevBuild")
number_slider_2 = Slider(6, range=0..1000)

# ----
do = DirectOnly(Samples=number_slider_2, version="1.0.0.0")

# ---- group: Create shading masks for each analysis point (continued)
sma = ShadingMaskAnalysis(
    Run=Toggle(True),
    SceneObjects=scene_objects,
    AnalysisPoints=analysis_points_2,
    Hemisphere=hemisphere_3,
    SamplingSettings=do,
    VisibilityMask="""{
  "Mask1": true,
  "Mask2": true,
  "Mask3": true,
  "Mask4": true,
  "Mask5": true,
  "Mask6": true,
  "Mask7": true,
  "Mask8": true,
  "BitMap": [
    true,
    true,
    true,
    true,
    true,
    true,
    true,
    true
  ]
}""",
    version="1.0.0.0")  # -> Scene, ShadingMasks

# ---- group: Run cumulative solar radiation analysis
radiation_analysis = CumulativeRadiation(ShadingMasks=sma.ShadingMasks, SkySeries=ss, method="Cumulative Radiation", version="0.0.0.DevBuild")  # -> CumulativeRadiation, AverageIrradiance

# ---- group: Visualize analysis results on facade panels
analysis_results = Number(simplify(radiation_analysis.CumulativeRadiation))
facade_panels_2 = Geometry(trim)
gradient = Gradient(
    LowerLimit=0,
    UpperLimit=Slider(700, range=0..1000),
    Parameter=analysis_results,
    stops=[0: RGB(0, 255, 255), 0.496: RGB(0, 0, 0), 1: RGB(255, 0, 255)])
mesh_colours = MeshColours(Mesh=graft(facade_panels_2), Colours=graft(gradient))

# ----
# maximise sun hours
fytp_2 = FullYear(TimeStep=1, version="1.2.0.60000")
sr = SunRig(
    NorthVector=Vector(0, 1, 0),
    Location="""{
  "Latitude": 51.48,
  "Longitude": 0,
  "Timezone": 0,
  "Country": "United Kingdom",
  "AdminDistrict": "London",
  "AddressLine": "Greenwich"
}""",
    TimePattern=fytp_2,
    CutOffElevation=0,
    method="Sun Rig",
    version="1.2.0.60000")
sha = SunlightHourAnalysis(
    Run=True,
    SceneObjects=scene_objects,
    SunRig=sr,
    AnalysisPoints=analysis_points_2,
    VisibilityMask="""{
  "Mask1": true,
  "Mask2": true,
  "Mask3": true,
  "Mask4": true,
  "Mask5": true,
  "Mask6": true,
  "Mask7": true,
  "Mask8": true,
  "BitMap": [
    true,
    true,
    true,
    true,
    true,
    true,
    true,
    true
  ]
}""",
    method="Sunlight Hour Analysis",
    version="1.2.0.60000")  # -> Scene, SunlightHours

# ----
# cumulative sun hours per voxel
ma = MassAddition(Input=sha.SunlightHours)  # -> Result, PartialResults
data_2 = Data(simplify(ma.Result))

# ----
# cumulative radiation per voxel
ma_2 = MassAddition(Input=analysis_results)  # -> Result, PartialResults
data_3 = Data(simplify(ma_2.Result))

# ----
# per voxel metrics go in here
# calculate reward
merge = Merge(Data1=data_3, Data2=data_2)
py3_3 = Python3Script(
    metrics=merge,
    path=panel_4,
    symmetry_score=data,
    w_rad=radiation_per_voxel_weight,
    w_sun=sunhours_weight,
    w_sym=symmetry_weight,
    w_cumrad=avergae_rad_per_voxel_weight)  # -> out, a; inputs metrics: tree
# ---------- py3_3: Python ----------
import json
import os

# Inputs from Grasshopper:
#   path (string) -> path to temp_reward.json
#   metrics (DataTree) -> per-voxel metrics { index: [radiation, sun] }
#   symmetry_score (float) -> system-wide symmetry score (0–1)
#   w_rad (float) -> weight for per-voxel radiation
#   w_sun (float) -> weight for per-voxel sun hours
#   w_sym (float) -> weight for symmetry
#   w_cumrad (float) -> weight for cumulative (avg) radiation

output_file = path

# ✅ Validate weights
if w_rad is None or w_sun is None or w_sym is None or w_cumrad is None:
    print("❌ Missing weight inputs")
    exit()

total_reward = 0.0
valid = True
cumulative_radiation = 0.0
occupied_voxels = 0

try:
    # --- 1️⃣ Per-voxel reward loop ---
    for i in range(metrics.BranchCount):
        raw_entry = metrics.Branch(i)
        entry = list(raw_entry)  # ✅ Convert .NET list to Python list

        if not isinstance(entry, list) or len(entry) < 2:
            print(f"❌ Invalid metric at index {i}: {entry}")
            valid = False
            break

        rad = float(entry[0])
        sun = float(entry[1])

        # Add to cumulative radiation & count
        cumulative_radiation += rad
        occupied_voxels += 1

        # Per-voxel reward
        voxel_reward = (w_rad * rad) + (w_sun * sun)
        total_reward += voxel_reward

    # --- 2️⃣ Add system-wide metrics if loop was valid ---
    if valid:
        # ✅ Normalize cumulative radiation
        avg_cumulative_radiation = cumulative_radiation / occupied_voxels if occupied_voxels > 0 else 0.0

        # ✅ Add symmetry
        total_reward += (w_sym * symmetry_score)

        # ✅ Add cumulative (average) radiation
        total_reward += (w_cumrad * avg_cumulative_radiation)

except Exception as e:
    print("❌ Error in parsing:", e)
    valid = False

# ✅ Write reward file if all entries were valid
if valid:
    with open(output_file, 'w') as f:
        json.dump({"reward": float(total_reward)}, f)
    print(f"✅ Reward written: {total_reward}")
else:
    print("❌ Reward not written due to error.")
# ---------- end py3_3 ----------

panel_7 = Panel(py3_3.out)
