# Grasshopper definition RL_Voxel_V3_hops.gh (Grasshopper 1.0.8)
# plug-ins: MeshEdit Components, Cyclops

# ---- group: Specify hemisphere subdivision
subdivision = Subdivision(CyclopsValueList="EqualAreaAspectSubdivision", version="1.0.0.0")
cell_count = Slider(512, range=0..1000)
hemisphere = Hemisphere(CellCount=cell_count, Subdivision=subdivision, method="Hemisphere", version="0.0.0.DevBuild")

# ----
# reward weights
sunhours_weight = Slider(1, range=0.1..1)
radiation_weight = Slider(0.8, range=0.1..1)

# ----
# reads voxels, makes boxes
voxel_json = GetString("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", AtLeast=1, AtMost=1, Prompt="json string of voxel positions", TreeAccess=False)

py3 = Python3Script(voxels_json=voxel_json)  # -> out, a; inputs voxels_json: String
# ---------- py3: Python ----------
# venv: lichen
import Rhino.Geometry as rg
import json

voxels = json.loads(voxels_json)['voxels']
boxes = []
print(voxels)
size = len(voxels)
for x in range(size):
    for y in range(size):
        for z in range(size):
            if voxels[x][y][z] == 1:
                pt1 = rg.Point3d(x, y, z)
                pt2 = rg.Point3d(x + 1, y + 1, z + 1)
                bbox = rg.BoundingBox(pt1, pt2)
                boxes.append(rg.Box(bbox))

# Output: list of voxel Boxes
a = boxes
# ---------- end py3 ----------

geo = Geometry(graft(py3.a))
debrep = DeconstructBrep(Brep=geo)  # -> simplify(Faces), Edges, Vertices
mesh_uv = MeshSurface(Surface=debrep.Faces, UCount="3", VCount="3", Overhang=True, Equalize=False)

mesh = Mesh(mesh_uv)

# ---- group: Create panels
facade_panels = Mesh(mesh)

# ----
# CUMULATIVE RADIATION
G = Geometry(Mesh=flatten(mesh), MaterialName="Default Material", Parameter=0, method="Geometry", version="1.0.0.0")
explode = MeshExplode(Mesh=mesh, Interpolate=False)
face_normals = FaceNormals(Mesh=facade_panels)  # -> Centers, Normals
trim = TrimTree(Tree=explode, Depth=1)
A = AnalysisPoint(Position=face_normals.Centers, Direction=face_normals.Normals, method="Analysis Point", version="1.0.0.0")
analysis_points = CyclopsObject(A, version="0.0.0.DevBuild")
trim_2 = TrimTree(Tree=analysis_points, Depth=1)
hemisphere_2 = Data(hemisphere)

# ---- group: Cyclops geometry
G_2 = GeometryGroup(
    Name="Default Geometry Group",
    Geometry=G,
    VisibilityMask="""{
  "Mask1": true,
  "Mask2": true,
  "Mask3": true,
  "Mask4": true,
  "Mask5": true,
  "Mask6": true,
  "Mask7": true,
  "Mask8": true,
  "BitMap": [
    true,
    true,
    true,
    true,
    true,
    true,
    true,
    true
  ]
}""",
    Transforms={TransformCount=1, Name="Generic", m00=1, m01=0, m02=0, m03=0, m10=0, m11=1, m12=0, m13=0, m20=0, m21=0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},
    IntersectionType="Target",
    method="Geometry Group",
    version="1.0.0.0")

# ---- group: Create shading masks for each analysis point
scene_objects = CyclopsObject(G_2, version="0.0.0.DevBuild")
hemisphere_3 = Data(hemisphere)
analysis_points_2 = CyclopsObject(trim_2, version="0.0.0.DevBuild")
do = DirectOnly(Samples=Slider(200, range=0..1000), version="1.0.0.0")
sma = ShadingMaskAnalysis(
    Run=Toggle(True),
    SceneObjects=scene_objects,
    AnalysisPoints=analysis_points_2,
    Hemisphere=hemisphere_3,
    SamplingSettings=do,
    VisibilityMask="""{
  "Mask1": true,
  "Mask2": true,
  "Mask3": true,
  "Mask4": true,
  "Mask5": true,
  "Mask6": true,
  "Mask7": true,
  "Mask8": true,
  "BitMap": [
    true,
    true,
    true,
    true,
    true,
    true,
    true,
    true
  ]
}""",
    version="1.0.0.0")  # -> Scene, ShadingMasks

# ----
# maximise sun hours
fytp = FullYear(TimeStep=1, version="1.2.0.60000")
sr = SunRig(
    NorthVector=Vector(0, 1, 0),
    Location="""{
  "Latitude": 51.48,
  "Longitude": 0,
  "Timezone": 0,
  "Country": "United Kingdom",
  "AdminDistrict": "London",
  "AddressLine": "Greenwich"
}""",
    TimePattern=fytp,
    CutOffElevation=0,
    method="Sun Rig",
    version="1.2.0.60000")
sha = SunlightHourAnalysis(
    Run=True,
    SceneObjects=scene_objects,
    SunRig=sr,
    AnalysisPoints=analysis_points_2,
    VisibilityMask="""{
  "Mask1": true,
  "Mask2": true,
  "Mask3": true,
  "Mask4": true,
  "Mask5": true,
  "Mask6": true,
  "Mask7": true,
  "Mask8": true,
  "BitMap": [
    true,
    true,
    true,
    true,
    true,
    true,
    true,
    true
  ]
}""",
    method="Sunlight Hour Analysis",
    version="1.2.0.60000")  # -> Scene, SunlightHours

# ----
# cumulative sun hours per voxel
ma = MassAddition(Input=sha.SunlightHours)  # -> Result, PartialResults
data = Data(simplify(ma.Result))

# ----
# epw
panel = Panel("https://energyplus-weather.s3.amazonaws.com/europe_wmo_region_6/ESP/ESP_Barcelona.081810_SWEC/ESP_Barcelona.081810_SWEC.zip")

epw_url = GetString(panel, AtLeast=1, AtMost=1, TreeAccess=False)

downloadepw = LBDownloadWeather(weather_URL=epw_url)  # -> epw_file, stat_file, ddy_file; plug-in component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

# ---- group: Create sky instance from EPW file
W = Weather(Path=downloadepw.epw_file, NorthVector=Vector(0, 1, 0), LuminousEfficacyModel="MeasuredIlluminance", version="1.0.0.0")
fytp_2 = FullYear(TimeStep=1, version="1.0.0.0")
ss = SkySeries(
    Weather=W,
    Hemisphere=hemisphere_2,
    TimePattern=fytp_2,
    LuminanceDistributionModel="CIEStandardSkyModel",
    version="1.0.0.0")

# ---- group: Run cumulative solar radiation analysis
radiation_analysis = CumulativeRadiation(ShadingMasks=sma.ShadingMasks, SkySeries=ss, method="Cumulative Radiation", version="0.0.0.DevBuild")  # -> CumulativeRadiation, AverageIrradiance

# ---- group: Visualize analysis results on facade panels
analysis_results = Number(simplify(radiation_analysis.CumulativeRadiation))

# ----
# cumulative radiation per voxel
ma_2 = MassAddition(Input=analysis_results)  # -> Result, PartialResults
data_2 = Data(simplify(ma_2.Result))

# ----
# calculate reward
merge = Merge(Data1=data_2, Data2=data)
w_rad = GetNumber(radiation_weight, AtLeast=1, AtMost=1, Maximum=1.797693135e+308, Minimum=-1.797693135e+308, TreeAccess=False)
w_sun = GetNumber(sunhours_weight, AtLeast=1, AtMost=1, Maximum=1.797693135e+308, Minimum=-1.797693135e+308, TreeAccess=False)
py3_2 = Python3Script(metrics=merge, w_rad=w_rad, w_sun=w_sun)  # -> out, a, total_reward; inputs metrics: tree
# ---------- py3_2: Python ----------
import json
import os

# Validate weights
if w_rad is None or w_sun is None:
    print("❌ Missing weight inputs")
    exit()

total_reward = 0.0
valid = True

try:
    for i in range(metrics.BranchCount):
        raw_entry = metrics.Branch(i)
        entry = list(raw_entry)  # ✅ Convert from .NET list to Python list

        if not isinstance(entry, list) or len(entry) < 2:
            print(f"❌ Invalid metric at index {i}: {entry}")
            valid = False
            break

        rad = float(entry[0])
        sun = float(entry[1])
        voxel_reward = (w_rad * rad) + (w_sun * sun)
        total_reward += voxel_reward

except Exception as e:
    print("❌ Error in parsing:", e)
    valid = False
    total_reward = -0.2
# ---------- end py3_2 ----------

panel_2 = Panel(py3_2.total_reward)
c_bake = ContextBake(Content=py3_2.total_reward)
