# Grasshopper definition Karamba_hops.ghx (Grasshopper 1.0.8)
# plug-ins: Karamba3D

# ---- group: hops input
panel = Panel("""{"voxels": [[[1, 1, 0, 1, 1], [1, 0, 1, 1, 0], [1, 1, 1, 1, 1], [1, 1, 1, 1, 0], [0, 1, 0, 0, 0]], [[0, 1, 0, 0, 1], [1, 0, 0, 1, 
0], [1, 1, 1, 0, 1], [1, 0, 1, 1, 0], [0, 1, 1, 0, 0]], [[0, 1, 1, 0, 1], [1, 1, 1, 1, 0], [0, 1, 1, 0, 0], [1, 0, 1, 1, 0], [0,  
0, 1, 0, 0]], [[1, 1, 0, 0, 0], [0, 1, 1, 0, 0], [1, 1, 0, 0, 0], [0, 1, 1, 0, 0], [1, 1, 0, 0, 0]], [[1, 1, 0, 0, 0], [0, 1, 1,  
0, 0], [1, 1, 0, 0, 0], [0, 1, 1, 0, 0], [1, 1, 0, 0, 0]]]}""")
# reads voxels, makes boxes
voxel_json = GetString(panel, AtLeast=1, AtMost=1, Prompt="json string of voxel positions", TreeAccess=True)

# ----
py3 = Python3Script(voxels_json=voxel_json)  # -> out, a; inputs voxels_json: String
# ---------- py3: Python ----------
# venv: lichen
import Rhino.Geometry as rg
import json

voxels = json.loads(voxels_json)['voxels']
boxes = []
print(voxels)
size = len(voxels)
for x in range(size):
    for y in range(size):
        for z in range(size):
            if voxels[x][y][z] == 1:
                pt1 = rg.Point3d(x, y, z)
                pt2 = rg.Point3d(x + 1, y + 1, z + 1)
                bbox = rg.BoundingBox(pt1, pt2)
                boxes.append(rg.Box(bbox))

# Output: list of voxel Boxes
a = boxes
# ---------- end py3 ----------
geo = Geometry(graft(py3.a))

debrep = DeconstructBrep(Brep=geo)  # -> Faces, Edges, Vertices
evalsrf = EvaluateSurface(Surface=reparameterize(debrep.Faces), Point="0.5,0.5")  # -> Point, Normal, UDirection, VDirection, Frame
devec = DeconstructVector(Vector=evalsrf.Normal)  # -> XComponent, YComponent, ZComponent
equals = Equality(FirstNumber=devec.ZComponent, SecondNumber="0")  # -> Equality, Inequality
dispatch = Dispatch(List=debrep.Faces, DispatchPattern=equals.Equality)  # -> ListA, ListB
slab = Brep(dispatch.ListB)
walls = Brep(dispatch.ListA)

# ----
# i put supports at every vertex of the ground for now idk
debrep_2 = DeconstructBrep(Brep=geo)  # -> Faces, Edges, Vertices
pdecon = Deconstruct(Point=debrep_2.Vertices)  # -> XComponent, YComponent, ZComponent
round = Round(Number=pdecon.ZComponent)  # -> Nearest, Floor, Ceiling
equals_2 = Equality(FirstNumber=round.Nearest, SecondNumber="0")  # -> Equality, Inequality
dispatch_2 = Dispatch(List=debrep_2.Vertices, DispatchPattern=equals_2.Equality)  # -> ListA, ListB
geo_2 = Geometry(flatten(dispatch_2.ListA))
cullpt = CullDuplicates(Points=geo_2, Tolerance=0.1, CullMode=3)  # -> Points, Indices, Valence
supp = SupportKaramba3D(PosInd=cullpt.Points, menu=[buttons(on, on, on, on, on, on)])

matselect = MaterialSelectionKaramba3D(menu=[dropdown(1), dropdown(7), dropdown(6)])
matselect_2 = MaterialSelectionKaramba3D(menu=[dropdown(1), dropdown(5), dropdown(1)])

# ----
# vertical elements
number_slider = Slider(10, range=0..100)
crosec = CrossSectionKaramba3D(FamilyNameOfCrossSection="DefaultCroSec", Material=matselect_2, Height_cm=number_slider, mode="Shell - Const")
surfelem = CreateSurfaceElementKaramba3D(Mesh=walls, CrossSection=crosec, LimitDistance_m=0.005, Bending=True, mode="MeshToShell")  # -> Element, Points, Info

mesh_breps = MeshBrepsKaramba3D(Brep=slab, MeshResolution=1, EdgeRefinementFactor=0.67, PointReduction=False, SmoothingStepSize=0, SmoothingIterations=5)  # -> Mesh, Info

# ----
# horizontal elements
crosec_2 = CrossSectionKaramba3D(FamilyNameOfCrossSection="DefaultCroSec", Material=matselect, Height_cm="7.5", mode="Shell - Const")
surfelem_2 = CreateSurfaceElementKaramba3D(Mesh=mesh_breps.Mesh, CrossSection=crosec_2, LimitDistance_m=0.005, Bending=True, mode="MeshToShell")  # -> Element, Points, Info

loads = LoadsKaramba3D(
    Vector="0,0,-5",
    Mesh=flatten(mesh_breps.Mesh),
    LCase="LC0",
    mode="MeshLoad -Const.",
    menu=[buttons(on, off, off), buttons(on, on)])

# ----
# load cases
loads_2 = LoadsKaramba3D(Vector=Vector(0, 0, -1), LCase="LC0", mode="Gravity")
merge = Merge(Data1=loads_2, Data2=loads)

# ----
# all elements
merge_2 = Merge(Data1=surfelem.Element, Data2=surfelem_2.Element)  # -> flatten(Result)

# ----
# karamba assembly + analysis
assemble = AssembleModelKaramba3D(Elem=merge_2, Support=supp, Load=merge, LimitDistance_m=0.005)  # -> Model, Info, Mass_kg, CentreOfGravity, LoadCaseNames
analyse_analyze = AnalyseKaramba3D(Model=assemble.Model)  # -> AnalysedModel, MaximumDisplacement_cm, ResultingForce_kN, ChangeOfElasticEnergy_kNm
shellview = ShellViewKaramba3D(Model=analyse_analyze.AnalysedModel, IndexOfLayer=0)  # -> Model, MeshesOfRenderedShells, LegendColours, LegendTags; disabled
modelview = ModelViewKaramba3D(Model=analyse_analyze.AnalysedModel, Colours=shellview.LegendColours)  # -> Model, DeformedMesh, DeformedAxes, DeformedModel, MaximumDeformation
legend = Legend(Colour=shellview.LegendColours, Tags=shellview.LegendTags, LegendType=1)  # disabled

mesh = Mesh(modelview.DeformedMesh)  # disabled
nodedisp_nodedisp = NodalDisplacementsKaramba3D(AnalysedModel=modelview.Model)  # -> Model, NodalTranslations_m, NodalRotations_rad, DisplacementPosition, LoadCaseIndex
demesh = DeconstructMesh(Mesh=mesh)  # -> Vertices, Faces, Colours, Normals; disabled
demesh_2 = DeconstructMesh(Mesh=shellview.MeshesOfRenderedShells)  # -> Vertices, Faces, Colours, Normals; disabled
vlen = VectorLength(Vector=flatten(nodedisp_nodedisp.NodalTranslations_m))
conmesh = ConstructMesh(Vertices=demesh.Vertices, Faces=demesh.Faces, Colours=demesh_2.Colours)  # disabled
sort = SortList(Keys=vlen, ValuesA=vlen)  # -> Keys, ValuesA
item = ListItem(List=sort.ValuesA, Index="-1", Wrap=True)
one_over_x = OneOverX(Value=item)
division = Division(A=one_over_x, B=Slider(1000, range=0..1000))
c_bake = ContextBake(Inv_max_displacement=division)
panel_2 = Panel(division)
