# Grasshopper definition RL_Voxel_V4_hops.ghx (Grasshopper 1.0.8)
# plug-ins: Cyclops

panel = Panel("""{"voxels": [[[1, 1, 0, 1, 1], [1, 0, 1, 1, 0], [1, 1, 1, 1, 1], [1, 1, 1, 1, 0], [0, 1, 0, 0, 0]], [[0, 1, 0, 0, 1], [1, 0, 0, 1, 
0], [1, 1, 1, 0, 1], [1, 0, 1, 1, 0], [0, 1, 1, 0, 0]], [[0, 1, 1, 0, 1], [1, 1, 1, 1, 0], [0, 1, 1, 0, 0], [1, 0, 1, 1, 0], [0,  
0, 1, 0, 0]], [[1, 1, 0, 0, 0], [0, 1, 1, 0, 0], [1, 1, 0, 0, 0], [0, 1, 1, 0, 0], [1, 1, 0, 0, 0]], [[1, 1, 0, 0, 0], [0, 1, 1,  
0, 0], [1, 1, 0, 0, 0], [0, 1, 1, 0, 0], [1, 1, 0, 0, 0]]]}""")
voxel_json = GetString(panel, AtLeast=1, AtMost=1, Prompt="json string of voxel positions", TreeAccess=True)
py3 = Python3Script(voxels_json=voxel_json)  # -> out, a; inputs voxels_json: String
# ---------- py3: Python ----------
# venv: lichen
import Rhino.Geometry as rg
import json

voxels = json.loads(voxels_json)['voxels']
boxes = []
print(voxels)
size = len(voxels)
for x in range(size):
    for y in range(size):
        for z in range(size):
            if voxels[x][y][z] == 1:
                pt1 = rg.Point3d(x, y, z)
                pt2 = rg.Point3d(x + 1, y + 1, z + 1)
                bbox = rg.BoundingBox(pt1, pt2)
                boxes.append(rg.Box(bbox))

# Output: list of voxel Boxes
a = boxes
# ---------- end py3 ----------

# ----
# reads voxels, makes boxes
geo = Geometry(graft(py3.a))
debrep = DeconstructBrep(Brep=geo)  # -> simplify(Faces), Edges, Vertices
mesh_uv = MeshSurface(Surface=debrep.Faces, UCount="3", VCount="3", Overhang=True, Equalize=False)

mesh = Mesh(mesh_uv)

# ---- group: Create panels
facade_panels = Mesh(mesh)

# ---- group: Specify hemisphere subdivision
subdivision = Subdivision(CyclopsValueList="EqualAreaAspectSubdivision", version="1.0.0.0")
cell_count = Slider(512, range=0..1000)
hemisphere = Hemisphere(CellCount=cell_count, Subdivision=subdivision, method="Hemisphere", version="0.0.0.DevBuild")

# ----
txt = Text("C:\gits\RL_Voxel-Agent_PPO_V1\gh_files\ESP_Barcelona.081810_SWEC.epw")

# ----
# system symmetry
# (0.33 = 1 axis, 0.66, 2 axes, etc)
py3_2 = Python3Script(boxes=py3.a)  # -> out, simplify(a); inputs boxes: list
# ---------- py3_2: Python ----------
import Rhino
import Rhino.Geometry as rg
import scriptcontext as sc
import System  # ✅ Needed for System.Guid checks

def get_geometry(guids):
    """Convert Rhino GUIDs to geometry objects."""
    geoms = []
    for g in guids:
        obj = sc.doc.Objects.Find(g)  # find the object in the Rhino doc
        if obj: 
            geo = obj.Geometry
            geoms.append(geo)
    return geoms

def get_centers(boxes):
    """Extract the centers of boxes or breps."""
    centers = []
    for b in boxes:
        if isinstance(b, rg.Box):
            centers.append(b.Center)
        elif isinstance(b, rg.Brep):
            bb = b.GetBoundingBox(True)
            centers.append(bb.Center)
        elif isinstance(b, rg.BoundingBox):  
            centers.append(b.Center)
    return centers

def normalize(points):
    """Center all points around origin for easier symmetry checks."""
    xs = [p.X for p in points]
    ys = [p.Y for p in points]
    zs = [p.Z for p in points]
    cx, cy, cz = (sum(xs) / len(xs), sum(ys) / len(ys), sum(zs) / len(zs))
    return [rg.Point3d(p.X - cx, p.Y - cy, p.Z - cz) for p in points]

def symmetry_score(points, axis):
    """Check symmetry across a given axis ('x','y','z')."""
    pts_set = {(round(p.X,3), round(p.Y,3), round(p.Z,3)) for p in points}
    matches = 0
    
    for p in points:
        if axis == 'x':
            mp = (-p.X, p.Y, p.Z)
        elif axis == 'y':
            mp = (p.X, -p.Y, p.Z)
        elif axis == 'z':
            mp = (p.X, p.Y, -p.Z)
        if mp in pts_set:
            matches += 1
    
    return matches / float(len(points))

# -----------------------
# INPUT: boxes (could be GUIDs or geometry)
# OUTPUT: overall symmetry score (0.0 - 1.0)
# -----------------------

if boxes:
    # ✅ Convert GUIDs to geometry if needed
    if isinstance(boxes[0], System.Guid):
        boxes = get_geometry(boxes)

    centers = get_centers(boxes)
    centers = normalize(centers)
    
    score_x = symmetry_score(centers, 'x')
    score_y = symmetry_score(centers, 'y')
    score_z = symmetry_score(centers, 'z')
    
    overall_score = (score_x + score_y + score_z) / 3.0
else:
    overall_score = 0.0

a = overall_score
# ---------- end py3_2 ----------
symmetry_score = Panel(py3_2.a)

# ----
# reward weights
number_slider = Slider(1, range=0.1..1)
sunhours_weight = Slider(0.5, range=0.1..1)
radiation_weight = Slider(0.5, range=0.1..1)

w_rad = GetNumber(radiation_weight, AtLeast=1, AtMost=1, Maximum=1.797693135e+308, Minimum=-1.797693135e+308, TreeAccess=False)
w_sun = GetNumber(sunhours_weight, AtLeast=1, AtMost=1, Maximum=1.797693135e+308, Minimum=-1.797693135e+308, TreeAccess=False)
w_avg_rad = GetNumber(number_slider, AtLeast=1, AtMost=1, Maximum=1.797693135e+308, Minimum=-1.797693135e+308, TreeAccess=False)
w_sym = GetNumber(Slider(1, range=0.1..1), AtLeast=1, AtMost=1, Maximum=1.797693135e+308, Minimum=-1.797693135e+308, TreeAccess=False)

panel_2 = Panel("eda37359-7424-4940-a640-33d3095d3f23)")

# ----
# epw
panel_3 = Panel("https://energyplus-weather.s3.amazonaws.com/europe_wmo_region_6/ESP/ESP_Barcelona.081810_SWEC/ESP_Barcelona.081810_SWEC.zip")  # disabled

# ---- group: hops input
epw_url = GetString(panel_3, AtLeast=1, AtMost=1, TreeAccess=False)  # disabled

# ----
downloadepw = LBDownloadWeather(weather_URL=epw_url)  # -> epw_file, stat_file, ddy_file; disabled; plug-in component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

panel_4 = Panel(downloadepw.epw_file)  # disabled

# ----
# CUMULATIVE RADIATION
G = Geometry(Mesh=flatten(mesh), MaterialName="Default Material", Parameter=0, method="Geometry", version="1.0.0.0")
face_normals = FaceNormals(Mesh=facade_panels)  # -> Centers, Normals
A = AnalysisPoint(Position=face_normals.Centers, Direction=face_normals.Normals, method="Analysis Point", version="1.0.0.0")
analysis_points = CyclopsObject(A, version="0.0.0.DevBuild")
epw_path = GetString(txt, AtLeast=1, AtMost=1, TreeAccess=True)
trim = TrimTree(Tree=analysis_points, Depth=1)
hemisphere_2 = Data(hemisphere)

# ---- group: Cyclops geometry
G_2 = GeometryGroup(
    Name="Default Geometry Group",
    Geometry=G,
    VisibilityMask="""{
  "Mask1": true,
  "Mask2": true,
  "Mask3": true,
  "Mask4": true,
  "Mask5": true,
  "Mask6": true,
  "Mask7": true,
  "Mask8": true,
  "BitMap": [
    true,
    true,
    true,
    true,
    true,
    true,
    true,
    true
  ]
}""",
    Transforms={TransformCount=1, Name="Generic", m00=1, m01=0, m02=0, m03=0, m10=0, m11=1, m12=0, m13=0, m20=0, m21=0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},
    IntersectionType="Target",
    method="Geometry Group",
    version="1.0.0.0")

# ----
txt_2 = Text(epw_path)

# ---- group: Create sky instance from EPW file
W = Weather(Path=txt_2, NorthVector=Vector(0, 1, 0), LuminousEfficacyModel="MeasuredIlluminance", version="1.0.0.0")
fytp = FullYear(TimeStep=1, version="1.0.0.0")
ss = SkySeries(
    Weather=W,
    Hemisphere=hemisphere_2,
    TimePattern=fytp,
    LuminanceDistributionModel="CIEStandardSkyModel",
    version="1.0.0.0")

# ----
skyseries = Data(ss)

# ---- group: Create shading masks for each analysis point
scene_objects = CyclopsObject(G_2, version="0.0.0.DevBuild")
hemisphere_3 = Data(hemisphere)
analysis_points_2 = CyclopsObject(trim, version="0.0.0.DevBuild")
number_slider_2 = Slider(200, range=0..1000)

# ----
do = DirectOnly(Samples=number_slider_2, version="1.0.0.0")

# ---- group: Create shading masks for each analysis point (continued)
sma = ShadingMaskAnalysis(
    Run=Toggle(True),
    SceneObjects=scene_objects,
    AnalysisPoints=analysis_points_2,
    Hemisphere=hemisphere_3,
    SamplingSettings=do,
    VisibilityMask="""{
  "Mask1": true,
  "Mask2": true,
  "Mask3": true,
  "Mask4": true,
  "Mask5": true,
  "Mask6": true,
  "Mask7": true,
  "Mask8": true,
  "BitMap": [
    true,
    true,
    true,
    true,
    true,
    true,
    true,
    true
  ]
}""",
    version="1.0.0.0")  # -> Scene, ShadingMasks

# ---- group: Run cumulative solar radiation analysis
radiation_analysis = CumulativeRadiation(ShadingMasks=sma.ShadingMasks, SkySeries=skyseries, method="Cumulative Radiation", version="0.0.0.DevBuild")  # -> CumulativeRadiation, AverageIrradiance

# ---- group: Visualize analysis results on facade panels
analysis_results = Number(simplify(radiation_analysis.CumulativeRadiation))

# ----
# maximise sun hours
fytp_2 = FullYear(TimeStep=1, version="1.2.0.60000")
sr = SunRig(
    NorthVector=Vector(0, 1, 0),
    Location="""{
  "Latitude": 51.48,
  "Longitude": 0,
  "Timezone": 0,
  "Country": "United Kingdom",
  "AdminDistrict": "London",
  "AddressLine": "Greenwich"
}""",
    TimePattern=fytp_2,
    CutOffElevation=0,
    method="Sun Rig",
    version="1.2.0.60000")
sha = SunlightHourAnalysis(
    Run=True,
    SceneObjects=scene_objects,
    SunRig=sr,
    AnalysisPoints=analysis_points_2,
    VisibilityMask="""{
  "Mask1": true,
  "Mask2": true,
  "Mask3": true,
  "Mask4": true,
  "Mask5": true,
  "Mask6": true,
  "Mask7": true,
  "Mask8": true,
  "BitMap": [
    true,
    true,
    true,
    true,
    true,
    true,
    true,
    true
  ]
}""",
    method="Sunlight Hour Analysis",
    version="1.2.0.60000")  # -> Scene, SunlightHours

# ----
# cumulative sun hours per voxel
ma = MassAddition(Input=sha.SunlightHours)  # -> Result, PartialResults
data = Data(simplify(ma.Result))

# ----
# cumulative radiation per voxel
ma_2 = MassAddition(Input=analysis_results)  # -> Result, PartialResults
data_2 = Data(simplify(ma_2.Result))

# ----
# avg rad per voxel
data_3 = Data(flatten(ma_2.Result))
lng = ListLength(List=data_3)
ma_3 = MassAddition(Input=data_3)  # -> Result, PartialResults
division = Division(A=ma_3.Result, B=lng)
data_4 = Data(division)

# ----
# calculate reward
merge = Merge(Data1=data_2, Data2=data)
py3_3 = Python3Script(metrics=merge, avg_rad=data_4, symmetry=py3_2.a, w_rad=w_rad, w_sun=w_sun, w_avg_rad=w_avg_rad, w_sym=w_sym)  # -> out, total_reward; inputs metrics: tree
# ---------- py3_3: Python ----------
import json
import os

# Validate weights
if w_rad is None or w_sun is None:
    print("❌ Missing weight inputs")
    exit()

total_reward = 0.0
valid = True

try:
    for i in range(metrics.BranchCount):
        raw_entry = metrics.Branch(i)
        entry = list(raw_entry)  # ✅ Convert from .NET list to Python list

        if not isinstance(entry, list) or len(entry) < 2:
            print(f"❌ Invalid metric at index {i}: {entry}")
            valid = False
            break

        rad = float(entry[0])
        sun = float(entry[1])
        voxel_reward = (w_rad * rad) + (w_sun * sun)
        total_reward += voxel_reward

except Exception as e:
    print("❌ Error in parsing:", e)
    valid = False
    total_reward = -0.2
# ---------- end py3_3 ----------

division_2 = Division(A=py3_3.total_reward, B=Slider(1000000, range=0..1000000))
panel_5 = Panel(division_2)
c_print = ContextPrint(Reward=division_2)
